# Grasshopper definition 20240729.gh (Grasshopper 1.0.8)

point = Point(graft([<point referenced from the Rhino model> x7]))
graft_tree = GraftTree(Tree=point, IncludeEmptyLists=True, IncludeNullItems=True)

point_2 = Point(<point referenced from the Rhino model>)
sphere = Sphere(Base=point_2, Radius=Slider(71.986, range=0..100))
unit_z = UnitZ(Factor=Slider(53.098, range=0..100))
curve = Curve([<curve referenced from the Rhino model> x3])
extrude = Extrude(Base=curve, Direction=unit_z)
panel = Panel(curve)
loft = Loft(Curves=curve, Options={Adjust=False, Closed=False, LoftEnds=0, LoftSimp=0, LoftType=0, Rebuild=10, Refit=0.01})

circle_cnr = CircleCNR(Center=graft_tree, Normal=Vector(0, 0, 1), Radius=Slider(54, range=0..100))
circle_cnr_2 = CircleCNR(Center=graft_tree, Normal=Vector(0, 0, 1), Radius=Slider(4, range=0..10))
length = Length(Curve=circle_cnr)
list_item = ListItem(Index=0, Wrap=True)
panel_2 = Panel(list_item)
evaluate_curve = EvaluateCurve(Curve=reparameterize(circle_cnr), Parameter=[Slider(0.737, range=0..1), Slider(0.658, range=0..1)])  # -> Point, Tangent, Angle
line = Line(StartPoint=graft_tree, EndPoint=evaluate_curve.Point)
trim_with_region = TrimWithRegion(Curve=line, Region=circle_cnr_2)  # -> Inside, Outside
rotate = Rotate(Angle=1.570796327, Plane=PlaneXY(0, 0, 0))  # -> Geometry, Transform
curve_2 = Curve(trim_with_region.Outside)
