# Grasshopper definition 20240819_Iteration 1.gh (Grasshopper 1.0.8)

number_slider = Slider(123, range=0..1000)
circle = Circle(Plane=PlaneXY(0, 0, 0), Radius=number_slider)
addition = Addition(A=number_slider, B=Slider(100, range=0..100))
offset_curve = OffsetCurve(Curve=circle, Distance=addition, Corners=1)
divide_curve = DivideCurve(Curve=offset_curve, Count=Slider(20, range=0..20), Kinks=False)  # -> Points, Tangents, Parameters
dispatch = Dispatch(List=divide_curve.Points, DispatchPattern=[True, False])  # -> ListA, ListB
line = Line(StartPoint=dispatch.ListA, EndPoint=dispatch.ListB)
end_points = EndPoints(Curve=flatten(line))  # -> Start, End
offset_curve_2 = OffsetCurve(Curve=line, Distance=Slider(100, range=0..100), Corners=1)  # -> flatten(Curve)
end_points_2 = EndPoints(Curve=flatten(offset_curve_2))  # -> Start, End
line_2 = Line(StartPoint=end_points_2.Start, EndPoint=end_points.Start)
line_3 = Line(StartPoint=end_points_2.End, EndPoint=end_points.End)
