# Grasshopper definition 20241113_From the PC.gh (Grasshopper 1.0.8)
# plug-ins: Karamba3D

brep = Brep(<brep referenced from the Rhino model>)
crv = Curve(<curve referenced from the Rhino model>)
crv_2 = Curve(<curve referenced from the Rhino model>)
unit_z = UnitZ(Factor=1)
unit_z_2 = UnitZ(Factor=1)
divide = DivideCurve(Curve=crv, Count=Slider(34, range=0..100), Kinks=False)  # -> Points, Tangents, Parameters
mesh_to_shell_karamba3d = MToShell(Mesh=brep, LimitDistance_m=0.005)  # -> Element, Points, Info
divide_2 = DivideCurve(Curve=crv_2, Count=Slider(34, range=0..100), Kinks=False)  # -> Points, Tangents, Parameters
loads_karamba3d = Loads(Vector=unit_z, LCase="0", mode="Gravity")
material_selection_karamba3d = MatSelect(menu=[dropdown(0), dropdown(0)])
cross_section_karamba3d = CroSec(
    FamilyNameOfCrossSection="DefaultCroSec",
    Height_cm=9.6,
    UpperFlangeWidth_cm=10,
    LowerFlangeWidth_cm=10,
    UpperFlangeThickness_cm=0.8,
    LowerFlangeThickness_cm=0.8,
    WebThickness_cm=0.5,
    FilletRadius_cm=0,
    mode="I")
support_karamba3d = Supp(PosInd=divide.Points, menu=[buttons(off, off, on, off, off, off)])
loads_karamba3d_2 = Loads(Vector=unit_z_2, LCase="0", mode="Gravity")
material_selection_karamba3d_2 = MatSelect(menu=[dropdown(0), dropdown(0)])
cross_section_karamba3d_2 = CroSec(
    FamilyNameOfCrossSection="DefaultCroSec",
    Height_cm=9.6,
    UpperFlangeWidth_cm=10,
    LowerFlangeWidth_cm=10,
    UpperFlangeThickness_cm=0.8,
    LowerFlangeThickness_cm=0.8,
    WebThickness_cm=0.5,
    FilletRadius_cm=0,
    mode="I")
support_karamba3d_2 = Supp(PosInd=divide_2.Points, menu=[buttons(off, off, on, off, off, off)])
element = ElementKaramba3D(mesh_to_shell_karamba3d.Element)
element_2 = ElementKaramba3D()
assemble_model_karamba3d = Assemble(
    Elem=element,
    Support=support_karamba3d,
    Load=loads_karamba3d,
    CrossSection=cross_section_karamba3d,
    Material=material_selection_karamba3d,
    LimitDistance_m=0.005)  # -> Model, Info, Mass_kg, CentreOfGravity, LoadCaseNames
assemble_model_karamba3d_2 = Assemble(
    Elem=element_2,
    Support=support_karamba3d_2,
    Load=loads_karamba3d_2,
    CrossSection=cross_section_karamba3d_2,
    Material=material_selection_karamba3d_2,
    LimitDistance_m=0.005)  # -> Model, Info, Mass_kg, CentreOfGravity, LoadCaseNames
analyze_karamba3d = Analyze(Model=assemble_model_karamba3d.Model)  # -> CalculatedModel, MaximumDisplacement_cm, ResultingForceOfGravity_kN, ElasticEnergyChange_kNm
analyze_karamba3d_2 = Analyze(Model=assemble_model_karamba3d_2.Model)  # -> CalculatedModel, MaximumDisplacement_cm, ResultingForceOfGravity_kN, ElasticEnergyChange_kNm
model_view_karamba3d = ModelViewKaramba3D(Model=analyze_karamba3d.CalculatedModel)  # -> Model, DeformedMesh, DeformedAxes, DeformedModel, MaximumDeformation
model_view_karamba3d_2 = ModelViewKaramba3D(Model=analyze_karamba3d_2.CalculatedModel)  # -> Model, DeformedMesh, DeformedAxes, DeformedModel, MaximumDeformation
